# Grasshopper definition BrepToStructure.gh (Grasshopper 0.9.76)

number_slider = Slider(40, range=0..1000)
brep = Brep(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)
pop3d = Populate3D(Region=brep, Count=expr("x*2", number_slider), Seed=1)
brepinc = PointInBrep(Brep=brep, Point=pop3d, Strict=False)
popgeo = PopulateGeometry(Geometry=brep, Count=number_slider, Seed=1)
cull = CullPattern(List=pop3d, CullPattern=brepinc)
pt = Point([cull, popgeo])
prox = Proximity3D(Points=pt, Group=Slider(6, range=0..10))  # -> flatten(Links), Topology
pipe = Pipe(Curve=prox.Links, Radius=Slider(3, range=0..10), Caps=0)
